# Grasshopper definition simple ver2.gh (Grasshopper 1.0.7)
# plug-ins: HAL for Grasshopper, SeemoPredictor, Nullgh

sessionsettings = SessionSettings()
brep = Brep(<brep referenced from the Rhino model>)
brep_2 = Brep(<brep referenced from the Rhino model>)
# Single Viewpoint
pt = Point(<point referenced from the Rhino model>)
# Scene Geometry
geometry = Geometry([<brep referenced from the Rhino model> x5])
geometry_2 = Geometry([<brep referenced from the Rhino model> x2])
geometry_3 = Geometry([<brep referenced from the Rhino model> x174])
qrsettings = QuadRemeshSettings(TargetCount="100", AdaptiveSize=0, AdaptiveCount=False, HardEdges=False, SeamEdges=0, Symmetry=0, GuideCurves=0)
qrmesh = QuadRemesh(Mesh=brep_2, Settings=qrsettings)
sf = SeemoFace(Geometry=geometry, Type=0)
sf_2 = SeemoFace(Geometry=geometry_2, Type=1)
sf_3 = SeemoFace(Geometry=brep, Type=4)
sf_4 = SeemoFace(Geometry=geometry_3, Type=1)
facen = FaceNormals(Mesh=qrmesh)  # -> Centers, Normals
boolean_toggle = BooleanToggle(False)
sensor = Sensor(Point=pt, Resolution="90")
pt_2 = Point(<point referenced from the Rhino model>)
pdecon = Deconstruct(Point=pt_2)  # -> XComponent, YComponent, ZComponent
raytracing = RayTracing(Sensors=sensor, Faces=[sf, sf_2, sf_3, sf_4])  # -> Report, RT_Result
cpuraytracing = CPURayTracing(Run=boolean_toggle, GPU=boolean_toggle, Sensors=sensor)  # -> Report, RT_Result
viewanalyzer = ViewAnalyzer(Run=Toggle(False), Sensors=sensor, Faces=[sf, sf_2, sf_3, sf_4], GroundLevel=pdecon.ZComponent)  # -> Report, Result, ResultFilePath, OverallRatings, ViewContents, ViewAccesses, Privacys
predictor = Predictor(Run=boolean_toggle, RT_Result=cpuraytracing.RT_Result, GroundLevel=pdecon.ZComponent)  # -> Report, Result, ResultFilePath, OverallRatings, ViewContents, ViewAccesses, Privacys
panel = Panel("0")
visualizer = Visualizer(Path=viewanalyzer.ResultFilePath)  # -> OverallRatingGraph, ViewContentGraph, ViewAccessGraph, PrivacyGraph, OverallRating, ViewContent, ViewAccess, Privacy
python = GhPythonScript(res=predictor.Result, p="0", d=Slider(0, range=0..8))  # -> out, res, a; inputs p: Int32, d: Int32
# ---------- python: Python ----------
__author__ = "Timur"
__version__ = "2022.03.03"

import rhinoscriptsyntax as rs

_res =  res.Results[p].DirectionsResults[d]

pts =[]

for i in res.Results[p].DirectionsResults[d].Image.ImageRays:
    for j in i:
        pts.append(j)
    
a = pts
# ---------- end python ----------
panel_2 = Panel(python.a)
# Explode class for debugging
python_2 = GhPythonScript(x=viewanalyzer.Result, y=panel)  # -> out, pt, dir, d, c, b, a, e; inputs y: Int32
# ---------- python_2: Python ----------
__author__ = "Timur"
__version__ = "2022.03.03"

import rhinoscriptsyntax as rs

img = x.Results[0].DirectionsResults[y].Image

pt = rs.CreateVector(img.Pt.X, img.Pt.Y, img.Pt.Z)
dir = rs.CreateVector(img.Dir.X, img.Dir.Y, img.Dir.Z)

b = rs.CreateVector(img.TopCorner.X, img.TopCorner.Y, img.TopCorner.Z)
d = rs.CreateVector(img.xAxis.X, img.xAxis.Y, img.xAxis.Z)
c = rs.CreateVector(img.yAxis.X, img.yAxis.Y, img.yAxis.Z)

iray = x.Results[0].DirectionsResults[y].Image.ImageRaysFlat

pixrays = []
for i in iray:
  pixrays.append(rs.CreateVector(i.X, i.Y, i.Z))
a = pixrays


_hits = x.Results[0].DirectionsResults[y].Image.HitsFlat
hits = []
for i in _hits:
  hits.append(rs.CreatePoint(i.X, i.Y, i.Z))
e = hits
# ---------- end python_2 ----------
viewer = ImageViewer(Results=python.res)
mesh = Mesh(visualizer.PrivacyGraph)
mesh_2 = Mesh()
mesh_3 = Mesh()
mesh_4 = Mesh()
vdisex = VectorDisplayEx(Point=python_2.pt, Vector=expr("x*10", [python_2.b, python_2.c, python_2.d, python_2.dir]), Colour=RGB(0, 0, 0), Width=2)
vdisex_2 = VectorDisplayEx(Point=python_2.pt, Vector=expr("x*10", python_2.a), Colour=RGB(0, 0, 0), Width=2)
