# Grasshopper definition simple.gh (Grasshopper 1.0.7)
# plug-ins: SeemoPredictor

# Scene Geometry
geometry = Geometry([<brep referenced from the Rhino model> x5])
geometry_2 = Geometry(<brep referenced from the Rhino model>)
# Single Viewpoint
pt = Point(Point(1.060020935, 0.4267822768, 1.643102183))
brep = Brep(<brep referenced from the Rhino model>)
sf = SeemoFace(Geometry=geometry, Type=0)
sf_2 = SeemoFace(Geometry=geometry_2, Type=1)
sf_3 = SeemoFace(Geometry=brep, Type=4)
sensor = Sensor(Point=pt, Resolution="24")
viewanalyzer = ViewAnalyzer(Sensors=sensor, Faces=[sf, sf_2, sf_3])  # -> ResultFilePath, OverallRatings, ViewContents, ViewAccesses, Privacys, Result
# Explode class for debugging
panel = Panel("1")
python = GhPythonScript(x=viewanalyzer.Result, y=panel)  # -> out, pt, dir, d, c, b, a, e; inputs y: Int32
# ---------- python: Python ----------
__author__ = "Timur"
__version__ = "2022.03.03"

import rhinoscriptsyntax as rs

img = x.Results[0].DirectionsResults[y].Image

pt = rs.CreateVector(img.Pt.X, img.Pt.Y, img.Pt.Z)
dir = rs.CreateVector(img.Dir.X, img.Dir.Y, img.Dir.Z)

b = rs.CreateVector(img.TopCorner.X, img.TopCorner.Y, img.TopCorner.Z)
d = rs.CreateVector(img.xAxis.X, img.xAxis.Y, img.xAxis.Z)
c = rs.CreateVector(img.yAxis.X, img.yAxis.Y, img.yAxis.Z)

iray = x.Results[0].DirectionsResults[y].Image.ImageRaysFlat

pixrays = []
for i in iray:
  pixrays.append(rs.CreateVector(i.X, i.Y, i.Z))
a = pixrays


_hits = x.Results[0].DirectionsResults[y].Image.HitsFlat
hits = []
for i in _hits:
  hits.append(rs.CreatePoint(i.X, i.Y, i.Z))
e = hits
# ---------- end python ----------
python_2 = GhPythonScript(x=viewanalyzer.Result, y=panel)  # -> out, a, pt, dir, pixelrays, hitpts; inputs y: Int32; disabled
# ---------- python_2: Python ----------
__author__ = "Timur"
__version__ = "2022.03.03"

import rhinoscriptsyntax as rs

a = x.Results[0].DirectionsResults[y]

_vp = x.Results[0].Pt
_vdir = x.Results[0].DirectionsResults[y].Dir
pt = rs.CreatePoint(_vp.X, _vp.Y, _vp.Z)
dir = rs.CreateVector(_vdir.X, _vdir.Y, _vdir.Z)


pixrays = []
for i in a.sceneRayVectorsZ1:
  pixrays.append(rs.CreateVector(i.X, i.Y, i.Z))
pixelrays = pixrays


hits = []
for i in a.RayCastHits:
  hits.append(rs.CreatePoint(i.X, i.Y, i.Z))
hitpts = hits
# ---------- end python_2 ----------
vdisex = VectorDisplayEx(Point=python.pt, Vector=expr("x*10", [python.b, python.c, python.d, python.dir]), Colour=RGB(0, 0, 0), Width=2)
vdisex_2 = VectorDisplayEx(Point=python.pt, Vector=expr("x*10", python.a), Colour=RGB(0, 0, 0), Width=2)
vdisex_3 = VectorDisplayEx(Point=python_2.pt, Vector=python_2.dir, Colour=RGB(0, 0, 0), Width=2)  # disabled
visualizer0205 = Visualizer0205(Path=viewanalyzer.ResultFilePath)  # -> OverallRatingGraph, ViewContentGraph, ViewAccessGraph, PrivacyGraph; disabled
mesh = Mesh(visualizer0205.OverallRatingGraph)  # disabled
mesh_2 = Mesh(visualizer0205.ViewContentGraph)  # disabled
mesh_3 = Mesh(visualizer0205.ViewAccessGraph)  # disabled
mesh_4 = Mesh(visualizer0205.PrivacyGraph)  # disabled
